# Grasshopper definition receiveAndStuff.gh (Grasshopper 0.9.76)
# plug-ins: gHowl

# ---- group: OSC READ
port = Panel("3000")
netsource = NetworkSource()  # -> NetworkAdapterIsUp, AdapterProperties, LocalIpAddress
send_pattern_osc = Panel("999")
osc_addresses = Panel("/array")
udp = UDPReceiver(Port=port, Pattern=send_pattern_osc)  # -> Info, Data
osc_d = OSCDispatch(OSCDevices=osc_addresses, OSCMessage=udp.Data)  # -> OSCDevice, OSCData
message = Panel([udp.Info, udp.Data])
array = OSCChannel(OSCMessage=udp.Data)
osc_data = Panel(osc_d.OSCDevice)
osc_data_2 = Panel(osc_d.OSCData)
osc_data_3 = Panel(array)

# ----
split = TextSplit(Text=osc_data_2, Separators="{")
split_2 = TextSplit(Text=split, Separators="}")
split_3 = TextSplit(Text=split_2, Separators=",")
simplify = SimplifyTree(Tree=osc_data_2, Front=False)
panel = Panel(simplify)
toggle = BooleanToggle(True)
clean = CleanTree(RemoveNulls=toggle, RemoveInvalid=toggle, RemoveEmpty=toggle, Tree=split_3)
larger = LargerThan(FirstNumber=clean, SecondNumber=Slider(-1, range=-1..1))  # -> LargerThan, OrEqualTo
cull = CullPattern(List=clean, CullPattern=larger.LargerThan)  # -> simplify(List)
item = ListItem(List=cull, Index=1, Wrap=True)
slider = Slider(0, range=0..7)
item_2 = ListItem(List=cull, Index=0, Wrap=True)
item_3 = ListItem(List=simplify, Index=slider, Wrap=False)
neg = Negative(Value=item)
flatten = FlattenTree(Data=item_3, Path="{0}")
item_4 = ListItem(List=flatten, Index=slider, Wrap=False)
panel_2 = Panel(flatten)
toggle_2 = BooleanToggle(True)
pt = ConstructPoint(XCoordinate=item_2, YCoordinate=Slider(0, range=0..100), ZCoordinate=neg)
clean_2 = CleanTree(RemoveNulls=toggle_2, RemoveInvalid=toggle_2, RemoveEmpty=toggle_2, Tree=pt)
pt_2 = Point(clean_2)
pdecon = Deconstruct(Point=pt_2)  # -> XComponent, YComponent, flatten(ZComponent)
pt_3 = Point(panel_2)
neg_2 = Negative(Value=pdecon.ZComponent)
avr = Average(Input=neg_2)
panel_3 = Panel(avr)
Z = UnitZ(Factor=avr)
Z_2 = UnitZ(Factor=Slider(65.48, range=0..100))
move = Move(Geometry=pt_2, Motion=Z)  # -> Geometry, Transform
move_2 = Move(Geometry=move.Geometry, Motion=Z_2)  # -> Geometry, Transform
ln = Line(StartPoint=move.Geometry, EndPoint=move_2.Geometry)
Y = UnitY(Factor=Slider(100, range=0..100))
extr = Extrude(Base=ln, Direction=Y)
